# Grasshopper definition metaball_pyEddit.gh (Grasshopper 1.0.7)

# ----
# PARAMETRIC HOUSE
# Points
# Number
# Number of seeds on each of 3 dimensions (x,y,z)
# Planes construction
number_slider = Slider(15, range=0..100)

# ----
# Domain start
# The number displayed on this slider defines the
# minimum height that a point can be placed and
# an isocurve can be constructed
# 
# the negative expressions means the metaball is
# available on the negative side of z axis as well
domain_start = Slider(31.234, range=0..100)
negative = Negative(Value=domain_start)

# ----
# Domain end
# The number displayed on this slider defines the
# maximum height that a point can be placed and
# an isocurve can be constructed
domain_end = Slider(56.302, range=0..100)

# ----
# Seed
# Different seeds for each random set of points
# on in 3 dimensions and it defines the different
# outcomes for each set
number_slider_2 = Slider(22, range=0..100)

# ----
# Range
# The range of the region
# that points will be constructed on
number_slider_3 = Slider(36.74, range=0..100)

# ----
# Domain construction
# In order to define a set of planes for iso curves to be constructed on
# a domain is needed
construct_domain = ConstructDomain(DomainStart=negative, DomainEnd=domain_end)

# ----
# Points
# Points can be defined by any mean at need ,
# here though the points
# are defined and constructed by random
# parameters
random = Random(Range=number_slider_3, Number=number_slider, Seed=number_slider_2)
random_2 = Random(Range=Slider(27.332, range=0..100), Number=number_slider, Seed=Slider(11, range=0..100))
random_3 = Random(Range=Slider(9.745, range=0..100), Number=number_slider, Seed=Slider(15, range=0..100))
construct_point = ConstructPoint(XCoordinate=random, YCoordinate=random_2, ZCoordinate=random_3)

# ----
# Range
# In order to define a set of planes a range must
# be created to dictate the start point and end
# point of each plane as well as their quantity
# Steps
# The number displayed on this slider defines the
# number of steps the domain will be divided to
# in other word its simply the number of planes
# and in the end the number of iso curves
# *but the distance between them is defined by
# all three sliders in this section
steps = Slider(84, range=0..100)
range = Range(Domain=construct_domain, Steps=steps)

# ----
# Planes
# In order to construct a set of planes the origin
# will be defined by a set of points on the z axis
# and the planes are 2 dimensional thus on the x and y axis
# these parameters are changable
construct_point_2 = ConstructPoint(XCoordinate=0, YCoordinate=0, ZCoordinate=range)
xy_plane = XYPlane(Origin=construct_point_2)

# ----
# Evaluation
# In order to produce a clean brep with clear steps
# between each extrusion the extrusion distance
# needs to be the exact distance between each curve
# and on the z axis
# To do so we need to sum the domain start and
# the domain end then divide them by the number of steps
# *x is the domain start and because it has a negative
# expression it means it has to be substracted
# *y is the domain end
# *z is the number of steps
panel = Panel("(y-x)/z")
evaluate = Evaluate(Expression=panel, x=negative, y=domain_end, z=steps)

# ----
# Treshold
# The magnitude or intensity that must be
# exceeded for a reaction to happen
treshold = Slider(0.136, range=0..1)

# ----
# Metaball with treshold
# Rebuild
# Metaball
# Rebuilding the curves for a smoother result
metaball_t = MetaBallT(Points=construct_point, Plane=xy_plane, Threshold=treshold)  # -> flatten(Isocurve)
rebuild_curve = RebuildCurve(Curve=metaball_t, Degree="3", Count="50", Tangents=False)

# ----
# Extrusions have to be along the z axis
unit_z = UnitZ(Factor=evaluate)

# ----
# Extrusion
# Cap to create solid Breps
extrude = Extrude(Base=rebuild_curve, Direction=unit_z)
cap_holes = CapHoles(Brep=extrude)

custom_preview = CustomPreview(Geometry=cap_holes, Material=ColourSwatch(SwatchColor=RGB(255, 56, 56)))
